% Simulink data dictionary GlobalTypes.sldd

CommandAckBus = Simulink.Bus()  % 命令结果逐条确认（含多事件时序）
  CommandId: uint32  % 命令关联号（回显 CommanderRequestBus）
  Result: uint8  % 0=已批准, 1=已拒绝, 2=已中止
  ReasonCode: uint16  % 0=无, 1..7=起飞门#1..#7, 8=阶段非法, 9=参数非法, 10=安全否决(后置)
  Message: uint8[32]  % ASCII 原因文本（供操作者 HMI，DEC-003）
  Valid: boolean  % 确认事件完整有效

CommanderRequestBus = Simulink.Bus()  % GCS 写命令请求（协议无关，Gateway → Commander）
  CommandId: uint32  % 命令关联号（单调递增，CommandAckBus 回显）
  Command: uint8  % 1=加锁, 2=解锁, 3=开始任务, 4=返航, 5=降落, 6=悬停, 7=接管, 8=go-to-point, 9=载荷控制(后置)
  Params: single[8]  % 命令参数（如 go-to-point 目标 NED）；未用槽位置 0
  Valid: boolean  % 请求字段已完成校验（不等于 Commander 已授权执行）

CommanderStatusBus = Simulink.Bus()  % Commander 运行状态流（契约 #6）
  Armed: boolean  % 是否加锁（DEC-103）
  CurrentMode: uint8  % 0=待机, 1=任务执行, 2=返航, 3=降落, 4=悬停
  LastCommandResult: uint8  % 最近命令结果缓存：0=已批准, 1=已拒绝, 2=已中止（回显 CommandAckBus）
  LastCommandId: uint32  % 最近结果对应的 CommandId
  SafetyState: uint8  % 0=正常, 1=降级, 2=failsafe, 3=应急 — 已定义未落地（FailSafe 后置）
  SafetyDirective: uint8  % 0=无, 1=悬停, 2=返航, 3=降落, 4=禁止执行器 — 已定义未落地
  MissionDirective: uint8  % 0=继续, 1=挂起, 2=终止 — 已定义未落地
  FailsafeActive: boolean  % FailSafe 已触发 — 已定义未落地
  Valid: boolean  % 状态样本已初始化

DynamicModelBus = Simulink.Bus()  % 动力学模型给出的真实状态
  Position_NED: single[3], Unit="m"  % 位置(北东地)
  Velocity_NED: single[3], Unit="m/s"  % 速度(北东地)
  Attitude_quat: single[4]  % 四元数[w x y z]
  AngularRate_Body: single[3], Unit="rad/s"  % 机体角速度
  Accel_Body: single[3], Unit="m/s^2"  % 机体加速度(不含重力)

EscCmdBus = Simulink.Bus()  % 飞控至动力系统的电调控制指令
  MotorCmd: single[4], Unit="1"  % 各电机油门指令（归一化）
  Armed: boolean  % 执行器解锁状态，false时必须输出disarmed安全值
  Valid: boolean  % 当前执行器指令是否有效，false时禁止保持旧命令

ExperimentTraceBus = Simulink.Bus()  % 最小实验跟踪帧（真值+传感器+估计输出+执行器命令）
  SourceId: uint16  % 运行时源标识
  Sequence: uint32  % 运行时帧序号
  Timestamp: double, Unit="s"  % 运行时仿真时间戳
  Valid: boolean  % 跟踪帧有效标志
  TruthPosition_NED: single[3], Unit="m"  % 真值位置（NED）
  TruthVelocity_NED: single[3], Unit="m/s"  % 真值速度（NED）
  IMUAccel: single[3], Unit="m/s^2"  % IMU 比力
  IMUGyro: single[3], Unit="rad/s"  % IMU 角速度
  IMUValid: boolean  % IMU 帧有效
  GPS_LLA: single[3]  % GPS 经纬高测量
  GPSVelocity: single[3], Unit="m/s"  % GPS 速度测量
  GPSValid: boolean  % GPS 帧有效
  StatePosition_NED: single[3], Unit="m"  % 估计器位置输出
  StateVelocity_NED: single[3], Unit="m/s"  % 估计器速度输出
  EscMotorCmd: single[4]  % 归一化电机指令输出
  PositionError_NED: single[3], Unit="m"  % 估计-真值 位置误差
  VelocityError_NED: single[3], Unit="m/s"  % 估计-真值 速度误差

GPSBus = Simulink.Bus()  % GPS/RTK 测量帧（含有效性与采样时间戳）
  Lat: single, Unit="deg"  % 纬度
  Lon: single, Unit="deg"  % 经度
  Alt: single, Unit="m"  % 海拔
  Velocity: single[3], Unit="m/s"  % NED 速度
  Valid: boolean  % 测量帧有效标志
  Timestamp: double, Unit="s"  % 测量采样时间戳
  IsNew: boolean  % GPS 消息为新帧

GcsLinkStatusBus = Simulink.Bus()  % 协议无关的地面站链路状态
  SourceId: uint32  % 地面站内部源标识
  RxSequence: uint32  % 接收事件单调序号
  LastRxTimeSec: double, Unit="s"  % 最近有效事件接收时刻
  LinkQuality: single  % 归一化链路质量（0~1）
  Connected: boolean  % 地面站已连接
  Valid: boolean  % 链路状态样本已初始化

IMUBus = Simulink.Bus()  % IMU 原始测量帧（含有效性与采样时间戳）
  Accel: single[3], Unit="m/s^2"  % 机体坐标系比力
  Gyro: single[3], Unit="rad/s"  % 机体坐标系角速率
  Valid: boolean  % 测量帧有效标志
  Timestamp: double, Unit="s"  % 测量采样时间戳
  IsNew: boolean  % IMU 消息为新帧

MissionControlRequestBus = Simulink.Bus()  % Commander 批准后路由到 MissionManager 的操作请求
  RequestId: uint32  % 请求关联号（单调递增）
  CommandId: uint32  % 源命令编号（用于 Ack 关联）
  Action: uint8  % 1=开始任务, 2=返航, 3=降落, 4=悬停, 5=接管, 6=go-to-point 激活；暂停/继续/取消 后置
  TargetPositionNED: single[3], Unit="m"  % go-to-point 目标 NED（Action=6）；其他动作忽略
  Valid: boolean  % 请求字段已完成校验（不等于 Commander 已授权）

MissionPlanAvailableBus = Simulink.Bus()  % 任务计划可用性通知（数据通道状态流）
  Available: boolean  % 计划通过解析+结构校验、可用于执行
  ReasonCode: uint16  % Available=false 时拒绝原因：1=不可解析, 2=字段非法, 3=容量>400, 4=末航点非停, 5=段结构非法
  PlanId: uint32  % 被报告的计划编号
  Valid: boolean  % 通知事件完整有效

MissionPlanBus = Simulink.Bus()  % A1 任务航线快照（最多 400 航点，定长扁平）
  TaskId: uint32  % 任务编号
  Version: uint32  % 计划版本
  Timestamp: double, Unit="s"  % 计划生成时间
  Frame: uint8  % 坐标参考系：0=NED 局部
  ReferencePointNED: single[3], Unit="m"  % 锚定参考点（A-003）
  HeightRef: uint8  % 高度参考：0=相对声明参考点
  FinishAction: uint8  % 末点后行为：0=无, 1=返航, 2=降落, 3=悬停
  LinkLossDefault: uint8  % 链路丢失默认：0=悬停, 1=返航, 2=继续（DEC-004）
  SafeTakeoffHeight: single, Unit="m"  % 起飞段安全起飞高度（DEC-045）
  DepartureSpeed: single, Unit="m/s"  % 去首点速度（DEC-082）
  DefaultSpeed: single, Unit="m/s"  % 段默认巡航速度
  DefaultClimbRate: single, Unit="m/s"  % 默认爬升/下降率
  ArrivalDefault: single[4]  % 默认到达判据 [位置,速度,高度,偏航]（DEC-055）
  DefaultYawMode: uint8  % 默认偏航：0=跟随航线, 1=固定航向
  WaypointCount: uint16  % 有效航点数（≤400）
  Lat: single[400], Unit="deg"  % 航点纬度
  Lon: single[400], Unit="deg"  % 航点经度
  Height: single[400], Unit="m"  % 航点高度（相对参考点）
  Speed: single[400], Unit="m/s"  % 航点速度覆盖（0=用 config 默认）
  ClimbRate: single[400], Unit="m/s"  % 航点爬升率覆盖（0=用 config 默认）
  PassMode: uint8[400]  % 0=直线/停, 1=直线/过, 2=曲线/停, 3=曲线/过
  YawMode: uint8[400]  % 0=跟随航线, 1=固定航向
  YawParam: single[400], Unit="rad"  % 固定航向角度（YawMode=1 时）
  ArrivalPos: single[400], Unit="m"  % 到达位置半径覆盖（0=config 默认）
  ArrivalVel: single[400], Unit="m/s"  % 到达速度覆盖（0=config 默认）
  ArrivalAlt: single[400], Unit="m"  % 到达高度覆盖（0=config 默认）
  ArrivalYaw: single[400], Unit="rad"  % 到达偏航覆盖（0=config 默认）
  ActionTrigger: uint8[400]  % 动作触发：0=无, 1=到达触发 — 已定义未落地
  ActionCount: uint8[400]  % 动作序列条数 — 已定义未落地
  PayloadValid: boolean[400]  % 云台载荷字段 — 已定义未落地
  IsRisky: boolean[400]  % 风险标记 — 已定义未落地
  CoordinatedTurn: boolean[400]  % 协调转弯 — 已定义未落地
  Valid: boolean  % 整个快照已完成校验

MissionStatusBus = Simulink.Bus()  % 任务执行状态与进度（内部消费者订阅）
  PlanId: uint32  % 当前锁存航线编号；无有效计划时为 0
  PlanValid: boolean  % 完整航线已原子锁存并可供执行
  ExecutionPhase: uint8  % 0=待命, 1=执行中, 2=暂停(后置), 3=已结束
  MissionOutcome: uint8  % 0=无结果, 1=成功, 2=取消(后置), 3=未成功
  MissionReason: uint8  % 结束/暂停原因：0=无, 1=航线完成, 2=操作者取消, 3=操作者暂停(后置), 4=显式推进, 5=安全挂起(后置), 6=内部错误, 7=安全终止(后置)
  CurrentItemIndex: uint8  % 当前任务项零基索引
  ItemCount: uint8  % 有效任务项总数
  ReachedItemIndex: int16  % 最近已到达的零基索引；-1 = 尚无
  ActiveContractId: uint32  % Navigator 当前应关联的运动学合同编号
  ExecutionHealthy: boolean  % 任务执行上下文内部可信
  MissionFaultCode: uint16  % 0=无故障；非零只报告 MM 自身异常事实
  LandingCompleted: boolean  % 末项 LAND 已满足条件、请求安全加锁（DEC-042）
  Valid: boolean  % 状态样本已初始化

NavigationContractBus = Simulink.Bus()  % 运动学合同（段=run），任务无关（DEC-085）
  ContractId: uint32  % 合同关联号（单调递增）
  PlanId: uint32  % 所属计划编号
  SegmentIndex: uint32  % 段索引（可追溯）
  StartValid: boolean  % false = Navigator 快照当前状态（DEC-065）
  StartPositionNED: single[3], Unit="m"  % 显式段起点（StartValid=true 时有效）
  PassCount: uint8  % 过点个数 n（0 = 纯停段）
  PassPositionNED: single[64 3], Unit="m"  % 过点序列（仅前 PassCount 项有效）
  EndPositionNED: single[3], Unit="m"  % 终止停点位置
  CruiseSpeed: single, Unit="m/s"  % 段巡航速度
  MaxAcceleration: single, Unit="m/s^2"  % 段最大加速度
  MaxJerk: single, Unit="m/s^3"  % 段最大加加速度
  TargetYaw: single, Unit="rad"  % 终止停点目标偏航（DEC-082）
  Valid: boolean  % 合同完整且已授权

NavigationStatusBus = Simulink.Bus()  % Navigator 制导状态流（含 Valid 可行性标志）
  ContractId: uint32  % 当前关联的运动学合同编号
  GuidanceState: uint8  % 0=等待合同, 1=段轨迹求值中, 2=悬停保持, 3=降落剖面
  Valid: boolean  % 轨迹参考有效性（正常流恒 true，最差=悬停保持，DEC-086）

RouteWindowBus = Simulink.Bus()  % 已锁存计划的当前航段滑动窗口（MM 内部段视图）
  PlanId: uint32  % 所属计划编号
  ItemIndex: uint8  % 当前项零基索引
  PreviousValid: boolean  % 前一锚点可用
  PreviousPositionNED: single[3], Unit="m"  % 前一导航锚点位置（NED）
  CurrentTaskType: uint8  % 当前任务项类型
  CurrentPositionNED: single[3], Unit="m"  % 当前航点位置（NED）
  CurrentYaw: single, Unit="rad"  % 当前航点偏航
  AcceptanceRadius: single, Unit="m"  % 当前终止停点位置容差
  TerminalBehavior: uint8  % 0=停, 1=过, 2=停留
  AdvancePolicy: uint8  % 0=显式推进, 1=自动
  DwellTime: single, Unit="s"  % 要求的终止停留时间
  CruiseSpeed: single, Unit="m/s"  % 请求的段巡航速度
  MaxAcceleration: single, Unit="m/s^2"  % 段最大加速度
  MaxJerk: single, Unit="m/s^3"  % 段最大加加速度
  NextValid: boolean  % 下一锚点可用
  NextPositionNED: single[3], Unit="m"  % 下一导航锚点位置（NED）
  IsFirstItem: boolean  % 当前项为首项
  IsLastItem: boolean  % 当前项为末项
  Valid: boolean  % 窗口完整且有界

RuntimeTruthBus = Simulink.Bus()  % 运行时真值状态（供跟踪与估计器对比；非 FlightCore 控制输入）
  SourceId: uint16  % 运行时源标识
  Sequence: uint32  % 运行时帧序号
  Timestamp: double, Unit="s"  % 运行时仿真时间戳
  Position_NED: single[3], Unit="m"  % 真值位置（NED）
  Velocity_NED: single[3], Unit="m/s"  % 真值速度（NED）
  Valid: boolean  % 真值帧有效标志

StateEstBus = Simulink.Bus()  % ESKF导航状态估计（位置、速度、姿态、偏置等）
  Position_NED: single[3], Unit="m"  % 位置估计（北东地）
  Velocity_NED: single[3], Unit="m/s"  % 速度估计（北东地）
  Attitude_quat: single[4]  % 姿态四元数 [w x y z]
  AngularRate_Body: single[3], Unit="rad/s"  % 机体角速度估计
  Accel_Body: single[3], Unit="m/s^2"  % 机体加速度估计（不含重力）
  GyroBias: single[3], Unit="rad/s"  % 陀螺零偏估计
  AccelBias: single[3], Unit="m/s^2"  % 加速度计零偏估计
  Wind_NED: single[3], Unit="m/s"  % 风速估计（北东地）
  Status: uint8  % 估计器状态（0未初始化,1稳定,2错误）

StateSnapshot = Simulink.Bus()  % SE→Navigator 当前状态快照（段边界锚点，仅位置/速度）
  Position_NED: single[3], Unit="m"  % 当前估计位置（NED）
  Velocity_NED: single[3], Unit="m/s"  % 当前估计速度（NED）

ThrustTorqueBus = Simulink.Bus()  % 动力系统输出的合力与合力矩（机体坐标系）
  Thrust_Body: single[3], Unit="N"  % 机体推力 [Fx, Fy, Fz]
  Torque_Body: single[3], Unit="N*m"  % 机体力矩 [Mx, My, Mz]

TrajectorySetpointBus = Simulink.Bus()  % Navigator 输出的连续轨迹参考（位置/速度/偏航，协议无关）
  Position_NED_SP: single[3], Unit="m"  % 局部 NED 位置参考
  Velocity_NED_SP: single[3], Unit="m/s"  % 局部 NED 速度参考
  Yaw_SP: single, Unit="rad"  % 偏航参考
  Valid: boolean  % 完整已授权轨迹参考