% Simulink data dictionary CommandContractDict.sldd

CommandAckBus = Simulink.Bus()  % 命令结果逐条确认（含多事件时序）
  SourceModule: uint8  % 逻辑源模块
  DestinationModule: uint8  % 逻辑目标模块
  CommandId: uint32  % 命令关联号（回显 CommandRequestBus）
  Result: uint8  % 0=None, 1=Approved, 2=Completed, 3=Rejected, 4=Aborted, 5=Failed
  ReasonCode: uint16  % 0=无, 1..7=起飞门#1..#7, 8=阶段非法, 9=参数非法, 10=安全否决(后置)
  Message: uint8[32]  % ASCII 原因文本（供操作者 HMI，DEC-003）
  Timestamp: double, Unit="s"  % 结果事件时间戳
  Valid: boolean  % 确认事件完整有效

CommandRequestBus = Simulink.Bus()  % 通用单播命令请求
  SourceModule: uint8  % 逻辑源模块
  DestinationModule: uint8  % 逻辑目标模块
  CommandId: uint32  % 命令关联号
  Command: uint8  % 共享命令枚举值（权威归 CommandContractDict，DEC-157）
  Params: double[8]  % 规范化命令参数槽
  ParamValidMask: uint16  % bit i 表示 Params(i) 有效，bits 8..15 保持 0
  Timestamp: double, Unit="s"  % 请求时间戳
  Valid: boolean  % 请求完整有效

CommanderStatusBus = Simulink.Bus()  % Commander 运行状态流（契约 #6）
  Armed: boolean  % 是否加锁（DEC-103）
  CurrentMode: uint8  % 0=待机, 1=任务执行, 2=返航, 3=降落, 4=悬停
  SafetyState: uint8  % 0=正常, 1=降级, 2=failsafe, 3=应急 — 已定义未落地（FailSafe 后置）
  SafetyDirective: uint8  % 0=无, 1=悬停, 2=返航, 3=降落, 4=禁止执行器 — 已定义未落地
  MissionDirective: uint8  % 0=继续, 1=挂起, 2=终止 — 已定义未落地
  FailsafeActive: boolean  % FailSafe 已触发 — 已定义未落地
  SafetyFieldsValid: boolean  % 安全占位字段当前是否有效
  Sequence: uint32  % 快照序号
  Timestamp: double, Unit="s"  % 快照时间戳
  Valid: boolean  % 状态样本已初始化

ModuleId_Gateway = Simulink.Parameter(uint8(1), StorageClass="ExportedGlobal")  % Gateway 逻辑模块 ID
ModuleId_Commander = Simulink.Parameter(uint8(2), StorageClass="ExportedGlobal")  % Commander 逻辑模块 ID
ModuleId_MissionManager = Simulink.Parameter(uint8(3), StorageClass="ExportedGlobal")  % MissionManager 逻辑模块 ID
Command_Disarm = Simulink.Parameter(uint8(1), StorageClass="ExportedGlobal")  % 第一阶段解除武装命令
Command_Arm = Simulink.Parameter(uint8(2), StorageClass="ExportedGlobal")  % 第一阶段武装命令
Command_StartMission = Simulink.Parameter(uint8(3), StorageClass="ExportedGlobal")  % 第一阶段开始任务命令
Command_ReturnToLaunch = Simulink.Parameter(uint8(4), StorageClass="ExportedGlobal")  % 后置占位：返航
Command_LandAtCurrentPosition = Simulink.Parameter(uint8(5), StorageClass="ExportedGlobal")  % 后置占位：当前位置降落
Command_HoldPosition = Simulink.Parameter(uint8(6), StorageClass="ExportedGlobal")  % 后置占位：定点保持
Command_GoToPoint = Simulink.Parameter(uint8(7), StorageClass="ExportedGlobal")  % 后置占位：飞向指定点