% Simulink data dictionary ControlContractDict.sldd

EscCmdBus = Simulink.Bus()  % 飞控至动力系统的电调控制指令
  MotorCmd: single[4], Unit="1"  % 各电机油门指令（归一化）
  Armed: boolean  % 执行器解锁状态，false时必须输出disarmed安全值
  Sequence: uint32  % 主数据序号
  Timestamp: double, Unit="s"  % 指令时间戳
  Valid: boolean  % 当前执行器指令是否有效，false时禁止保持旧命令

EscCmdSnapshotBus = Simulink.Bus()  % 执行机构指令观察快照
  MotorCmd: single[4], Unit="1"  % 电机归一化指令
  Armed: boolean  % 执行器解锁状态
  CommandValid: boolean  % 原指令有效
  Sequence: uint32  % 快照序号
  Timestamp: double, Unit="s"  % 快照时间戳
  Valid: boolean  % 快照完整有效

PowerSystemStatusBus = Simulink.Bus()  % 能源充足状态权威快照
  EnergySufficient: boolean  % 能源裕度满足当前任务
  Sequence: uint32  % 快照序号
  Timestamp: double, Unit="s"  % 快照时间戳
  Valid: boolean  % 快照完整有效

PropulsionStatusBus = Simulink.Bus()  % 动力就绪状态权威快照
  PropulsionReady: boolean  % 动力及执行机构已就绪
  Sequence: uint32  % 快照序号
  Timestamp: double, Unit="s"  % 快照时间戳
  Valid: boolean  % 快照完整有效

TrajectorySetpointBus = Simulink.Bus()  % Navigator 输出的连续轨迹参考（位置/速度/偏航，协议无关）
  Position_NED_SP: single[3], Unit="m"  % 局部 NED 位置参考
  Velocity_NED_SP: single[3], Unit="m/s"  % 局部 NED 速度参考
  Yaw_SP: single, Unit="rad"  % 偏航参考
  Sequence: uint32  % 主数据序号
  Timestamp: double, Unit="s"  % 参考时间戳
  Valid: boolean  % 完整已授权轨迹参考

TrajectorySetpointSnapshotBus = Simulink.Bus()  % 轨迹参考观察快照
  Position_NED_SP: single[3], Unit="m"  % NED 位置参考
  Velocity_NED_SP: single[3], Unit="m/s"  % NED 速度参考
  Yaw_SP: single, Unit="rad"  % 偏航参考
  ReferenceValid: boolean  % 原参考有效
  Sequence: uint32  % 快照序号
  Timestamp: double, Unit="s"  % 快照时间戳
  Valid: boolean  % 快照完整有效