% Simulink data dictionary GatewayContractDict.sldd

GatewayActuatorTxRequestBus = Simulink.Bus()  % Gateway internal MAVLink ACTUATOR_OUTPUT_STATUS encode request
  Valid: boolean  % Request valid
  time_usec: uint64, Unit="us"  % Boot-relative timestamp
  active: uint32  % Active actuator bit mask
  actuator: single[32]  % Normalized actuator outputs

GatewayAttitudeTxRequestBus = Simulink.Bus()  % Gateway internal MAVLink ATTITUDE_QUATERNION encode request
  Valid: boolean  % Request valid
  time_boot_ms: uint32, Unit="ms"  % Boot-relative timestamp
  q1: single  % Quaternion scalar
  q2: single  % Quaternion x
  q3: single  % Quaternion y
  q4: single  % Quaternion z
  rollspeed: single, Unit="rad/s"  % Body roll rate
  pitchspeed: single, Unit="rad/s"  % Body pitch rate
  yawspeed: single, Unit="rad/s"  % Body yaw rate
  repr_offset_q: single[4]  % Representation offset quaternion

GatewayCommandAckTxRequestBus = Simulink.Bus()  % Gateway 内部 MAVLink COMMAND_ACK 编码请求
  Valid: boolean  % 请求有效
  command: uint16  % 外部 MAV_CMD
  result: uint8  % MAV_RESULT
  progress: uint8  % 第一阶段固定 0
  result_param2: int32  % 第一阶段固定 0
  target_system: uint8  % ACK 目标 SystemId
  target_component: uint8  % ACK 目标 ComponentId

GatewayCommandEnvelopeBus = Simulink.Bus()  % COMMAND_LONG/COMMAND_INT 解码后的 Gateway 内部统一包络
  IsNew: boolean  % 本帧包含新命令
  CarrierType: uint8  % 1=COMMAND_LONG，2=COMMAND_INT
  SystemID: uint8  % MAVLink 来源 SystemId
  ComponentID: uint8  % MAVLink 来源 ComponentId
  Sequence: uint8  % MAVLink 入站序号
  target_system: uint8  % 目标 SystemId
  target_component: uint8  % 目标 ComponentId
  command: uint16  % MAV_CMD 数值
  frame: uint8  % COMMAND_INT 坐标系；LONG 为 0
  Params: double[8]  % 统一参数向量
  ParamValidMask: uint16  % Params 有效位

GatewayFtpTxRequestBus = Simulink.Bus()  % Gateway 内部 MAVLink FILE_TRANSFER_PROTOCOL 响应编码请求
  target_network: uint8  % 响应目标网络
  target_system: uint8  % 响应目标 SystemId
  target_component: uint8  % 响应目标 ComponentId
  payload: uint8[251]  % MAVLink FTP payload

GatewayGlobalPositionTxRequestBus = Simulink.Bus()  % Gateway internal MAVLink GLOBAL_POSITION_INT encode request
  Valid: boolean  % Request valid
  time_boot_ms: uint32, Unit="ms"  % Boot-relative timestamp
  lat: int32, Unit="degE7"  % Latitude
  lon: int32, Unit="degE7"  % Longitude
  alt: int32, Unit="mm"  % MSL altitude
  relative_alt: int32, Unit="mm"  % Relative altitude
  vx: int16, Unit="cm/s"  % North velocity
  vy: int16, Unit="cm/s"  % East velocity
  vz: int16, Unit="cm/s"  % Down velocity
  hdg: uint16, Unit="cdeg"  % Heading

GatewayGpsRawTxRequestBus = Simulink.Bus()  % Gateway internal MAVLink GPS_RAW_INT encode request
  Valid: boolean  % Request valid
  time_usec: uint64, Unit="us"  % Timestamp (us)
  fix_type: uint8  % GPS fix type (placeholder/TBD)
  lat: int32, Unit="degE7"  % Latitude
  lon: int32, Unit="degE7"  % Longitude
  alt: int32, Unit="mm"  % MSL altitude
  eph: uint16, Unit="cm"  % Horizontal EPS (placeholder/TBD)
  epv: uint16, Unit="cm"  % Vertical EPS (placeholder/TBD)
  vel: uint16, Unit="cm/s"  % Ground speed
  cog: uint16, Unit="cdeg"  % Course over ground
  satellites_visible: uint8  % Visible satellites (placeholder/TBD)

GatewayHeartbeatTxRequestBus = Simulink.Bus()  % Gateway 内部 MAVLink HEARTBEAT 编码请求
  Valid: boolean  % 请求有效
  custom_mode: uint32  % MAVLink custom_mode
  type: uint8  % MAV_TYPE
  autopilot: uint8  % MAV_AUTOPILOT
  base_mode: uint8  % MAV_MODE_FLAG
  system_status: uint8  % MAV_STATE

GatewayLocalPositionTxRequestBus = Simulink.Bus()  % Gateway internal MAVLink LOCAL_POSITION_NED encode request
  Valid: boolean  % Request valid
  time_boot_ms: uint32, Unit="ms"  % Boot-relative timestamp
  x: single, Unit="m"  % NED north position
  y: single, Unit="m"  % NED east position
  z: single, Unit="m"  % NED down position
  vx: single, Unit="m/s"  % NED north velocity
  vy: single, Unit="m/s"  % NED east velocity
  vz: single, Unit="m/s"  % NED down velocity

GatewayMissionTxRequestBus = Simulink.Bus()  % Standard Mission response projection
  Kind: uint8  % 1 request,2 count,3 ack,4 item,5 current,6 reached
  target_system: uint8  % target_system
  target_component: uint8  % target_component
  seq: uint16  % seq
  count: uint16  % count
  command: uint16  % command
  frame: uint8  % frame
  current: uint8  % current
  autocontinue: uint8  % autocontinue
  param1: single  % param1
  param2: single  % param2
  param3: single  % param3
  param4: single  % param4
  x: int32  % x
  y: int32  % y
  z: single  % z
  type: uint8  % type
  mission_type: uint8  % mission_type

GatewayPositionTargetTxRequestBus = Simulink.Bus()  % Gateway internal MAVLink POSITION_TARGET_LOCAL_NED encode request
  Valid: boolean  % Request valid
  time_boot_ms: uint32, Unit="ms"  % Boot-relative timestamp
  x: single, Unit="m"  % NED north target
  y: single, Unit="m"  % NED east target
  z: single, Unit="m"  % NED down target
  vx: single, Unit="m/s"  % North velocity target
  vy: single, Unit="m/s"  % East velocity target
  vz: single, Unit="m/s"  % Down velocity target
  afx: single, Unit="m/s^2"  % North acceleration target
  afy: single, Unit="m/s^2"  % East acceleration target
  afz: single, Unit="m/s^2"  % Down acceleration target
  yaw: single, Unit="rad"  % Yaw target
  yaw_rate: single, Unit="rad/s"  % Yaw-rate target
  type_mask: uint16  % MAVLink type mask
  coordinate_frame: uint8  % MAVLink coordinate frame

GatewaySysStatusTxRequestBus = Simulink.Bus()  % Gateway internal MAVLink SYS_STATUS encode request
  Valid: boolean  % Request valid
  onboard_control_sensors_present: uint32  % Sensors present
  onboard_control_sensors_enabled: uint32  % Sensors enabled
  onboard_control_sensors_health: uint32  % Sensors healthy
  load: uint16, Unit="0.1%"  % CPU load (placeholder/TBD)
  voltage_battery: uint16, Unit="mV"  % Battery voltage (placeholder/TBD)
  current_battery: int16, Unit="cA"  % Battery current (placeholder/TBD)
  battery_remaining: int8, Unit="%"  % Battery remaining (placeholder/TBD)
  drop_rate_comm: uint16, Unit="0.01%"  % Comm drop rate (placeholder/TBD)
  errors_comm: uint16  % Comm errors (placeholder/TBD)
  errors_count1: uint16  % Error count 1 (placeholder/TBD)
  errors_count2: uint16  % Error count 2 (placeholder/TBD)
  errors_count3: uint16  % Error count 3 (placeholder/TBD)
  errors_count4: uint16  % Error count 4 (placeholder/TBD)

GatewayTimeSyncTxRequestBus = Simulink.Bus()  % Gateway internal MAVLink TIMESYNC encode request
  Valid: boolean  % Request valid
  tc1: int64, Unit="ns"  % Local response time
  ts1: int64, Unit="ns"  % Requester timestamp echo

GatewayVfrHudTxRequestBus = Simulink.Bus()  % Gateway internal MAVLink VFR_HUD encode request
  Valid: boolean  % Request valid
  heading: int16, Unit="cdeg"  % Heading (cdeg)
  throttle: uint16, Unit="0.1%"  % Throttle (0..1000 = 0..100%)
  alt: single, Unit="m"  % Altitude
  airspeed: single, Unit="m/s"  % Airspeed
  groundspeed: single, Unit="m/s"  % Groundspeed
  climb: single, Unit="m/s"  % Climb rate

GcsLinkDiagnosticBus = Simulink.Bus()  % GCS 链路协议诊断快照（仅供 Logging）
  HasAcceptedRx: boolean  % 是否存在已接纳帧证据
  LastAcceptedRxSequence: uint8  % 最后已接纳 MAVLink sequence
  LastAcceptedRxTimeSec: double, Unit="s"  % 最后已接纳帧时刻
  AcceptedRxCount: uint32  % 已接纳帧计数
  StructureRejectCount: uint32  % 结构拒绝计数
  SourceRejectCount: uint32  % 来源拒绝计数
  TargetRejectCount: uint32  % 目标拒绝计数
  UnsupportedMessageCount: uint32  % 不支持消息计数
  SequenceGapCount: uint32  % sequence 缺口累计
  DuplicateSequenceCount: uint32  % 重复 sequence 计数
  OutOfOrderSequenceCount: uint32  % 乱序 sequence 计数
  Sequence: uint32  % 快照序号
  Timestamp: double, Unit="s"  % 快照时间戳
  Valid: boolean  % 快照完整有效

GcsLinkStatusBus = Simulink.Bus()  % Gateway 发布的授权 GCS 协议连接事实
  Connected: boolean  % 地面站已连接
  Sequence: uint32  % 快照序号
  Timestamp: double, Unit="s"  % 快照时间戳
  Valid: boolean  % 链路状态样本已初始化