% Simulink data dictionary MissionContractDict.sldd

MissionFileProcessingResultBus = Simulink.Bus()  % MissionManager 返回的任务文件处理完成结果
  TransferId: uint32  % 回显当前文件交接关联号
  PlanId: uint32  % MissionManager 生成的计划标识
  Accepted: boolean  % 任务业务接受结论
  ReasonCode: uint16  % MissionManager 原始原因码
  ProcessingComplete: boolean  % 结果完整锁存后的保持电平

MissionFileTransferBus = Simulink.Bus()  % Gateway 到 MissionManager 的原始任务文件单槽交接
  TransferId: uint32  % 成功提交时分配的传输关联号
  FileSize: uint32, Unit="byte"  % Data 中有效文件字节数
  Data: uint8[1048576]  % 不透明原始任务文件字节
  Ready: boolean  % payload 完整锁存后的单次交付事件标志

MissionItemsBus = Simulink.Bus()  % Standard MAVLink task items; no private file encoding
  TransferId: uint32  % Upload identity
  Count: uint16  % Item count, max 400
  Command: uint16[400]  % MAV_CMD by zero-based seq
  Frame: uint8[400]  % MAV_FRAME
  Params: single[400 4]  % param1 to param4
  X: int32[400]  % Latitude E7
  Y: int32[400]  % Longitude E7
  Z: single[400], Unit="m"  % Altitude
  AutoContinue: uint8[400]  % autocontinue
  Ready: boolean  % Complete upload event

MissionPlanAvailableBus = Simulink.Bus()  % 任务计划可用性通知（数据通道状态流）
  Available: boolean  % 计划通过解析+结构校验、可用于执行
  PlanId: uint32  % 被报告的计划编号
  Sequence: uint32  % 快照序号
  Timestamp: double, Unit="s"  % 快照时间戳
  Valid: boolean  % 快照完整有效

MissionPlanBus = Simulink.Bus()  % MissionManager 内部规范化计划槽（standard Mission stop-waypoint execution）
  TaskId: uint32  % 任务编号
  SafeTakeoffHeight: single, Unit="m"  % 原地起飞目标高度
  CruiseSpeed: single, Unit="m/s"  % 全部普通航段的巡航速度
  WaypointCount: uint16  % 有效停点数量（最多 400）
  WaypointPositionNED: single[400 3], Unit="m"  % 规范化停点 NED 坐标，仅前 WaypointCount 行有效
  TargetYaw: single[400], Unit="rad"  % 各停点目标偏航，仅前 WaypointCount 项有效
  RawItemCount: uint16  % Original mission item count
  WaypointSeq: uint16[400]  % Original seq for each internal waypoint
  HoldSeconds: single[400], Unit="s"  % Waypoint dwell time
  Valid: boolean  % 计划槽包含完整可执行计划

MissionProcessingResultBus = Simulink.Bus()  % MM acceptance result for Mission protocol
  TransferId: uint32  % Upload identity
  PlanId: uint32  % Accepted plan id
  Result: uint8  % MAV_MISSION_RESULT
  Accepted: boolean  % Plan usable
  Valid: boolean  % Processing completed

MissionProgressBus = Simulink.Bus()  % 任务执行进度快照
  PlanId: uint32  % 计划编号
  CurrentItemIndex: uint16  % 当前任务项零基索引
  ItemCount: uint16  % 有效任务项总数
  ReachedItemIndex: int16  % 最近到达索引，-1 表示尚无
  ActiveContractId: uint32  % 当前运动学合同编号
  Sequence: uint32  % 快照序号
  Timestamp: double, Unit="s"  % 快照时间戳
  Valid: boolean  % 快照完整有效

MissionStatusBus = Simulink.Bus()  % 任务执行状态与进度（内部消费者订阅）
  PlanId: uint32  % 当前锁存航线编号；无有效计划时为 0
  ExecutionPhase: uint8  % 0=待命, 1=执行中, 2=暂停(后置), 3=已结束
  MissionOutcome: uint8  % 0=无结果, 1=成功, 2=取消(后置), 3=未成功
  MissionReason: uint8  % 结束/暂停原因：0=无, 1=航线完成, 2=操作者取消, 3=操作者暂停(后置), 4=显式推进, 5=安全挂起(后置), 6=内部错误, 7=安全终止(后置)
  ExecutionHealthy: boolean  % 任务执行上下文内部可信
  MissionFaultCode: uint16  % 0=无故障；非零只报告 MM 自身异常事实
  LandingCompleted: boolean  % 末项 LAND 已满足条件、请求安全加锁（DEC-042）
  Sequence: uint32  % 快照序号
  Timestamp: double, Unit="s"  % 快照时间戳
  Valid: boolean  % 状态样本已初始化