% Simulink data dictionary NavigationContractDict.sldd

NavigationContractBus = Simulink.Bus()  % 运动学合同（段=run），任务无关（DEC-085）
  ContractId: uint32  % 合同关联号（单调递增）
  PlanId: uint32  % 所属计划编号
  SegmentIndex: uint32  % 段索引（可追溯）
  StartValid: boolean  % false = Navigator 快照当前状态（DEC-065）
  StartPositionNED: single[3], Unit="m"  % 显式段起点（StartValid=true 时有效）
  PassCount: uint8  % 过点个数 n（0 = 纯停段）
  PassPositionNED: single[64 3], Unit="m"  % 过点序列（仅前 PassCount 项有效）
  EndPositionNED: single[3], Unit="m"  % 终止停点位置
  CruiseSpeed: single, Unit="m/s"  % 段巡航速度
  MaxAcceleration: single, Unit="m/s^2"  % 段最大加速度
  MaxJerk: single, Unit="m/s^3"  % 段最大加加速度
  TargetYaw: single, Unit="rad"  % 终止停点目标偏航（DEC-082）
  Valid: boolean  % 合同完整且已授权
  Sequence: uint32  % 锁存合同序号
  Timestamp: double, Unit="s"  % 锁存时间戳

NavigationStatusBus = Simulink.Bus()  % Navigator 制导状态流（含 Valid 可行性标志）
  ContractId: uint32  % 当前关联的运动学合同编号
  GuidanceState: uint8  % 0=等待合同, 1=段轨迹求值中, 2=悬停保持, 3=降落剖面
  GuidanceValid: boolean  % 制导输出当前有效
  Sequence: uint32  % 快照序号
  Timestamp: double, Unit="s"  % 快照时间戳
  Valid: boolean  % 状态快照完整有效