% Simulink data dictionary SimulationContractDict.sldd

DynamicModelBus = Simulink.Bus()  % 动力学模型给出的真实状态
  Position_NED: single[3], Unit="m"  % 位置(北东地)
  Velocity_NED: single[3], Unit="m/s"  % 速度(北东地)
  Attitude_quat: single[4]  % 四元数[w x y z]
  AngularRate_Body: single[3], Unit="rad/s"  % 机体角速度
  Accel_Body: single[3], Unit="m/s^2"  % 机体加速度(不含重力)

GnssScenarioBus = Simulink.Bus()  % GNSS 几何/环境场景（HDOP/VDOP/星数/定位类型）
  HDOP: single  % 水平精度因子
  VDOP: single  % 垂直精度因子
  NumSat: uint8  % 可见/参与解算卫星数
  FixType: uint8  % 定位类型（MAVLink GPS_FIX_TYPE）
  Sequence: uint32  % 场景帧序号
  Timestamp: double, Unit="s"  % 场景时间戳
  Valid: boolean  % 场景有效

InertialTruthBus = Simulink.Bus()  % MIL plant 惯性真值
  Attitude_quat: single[4]  % 姿态四元数
  AngularRate_Body: single[3], Unit="rad/s"  % 机体角速度
  Accel_Body: single[3], Unit="m/s^2"  % 机体加速度
  Sequence: uint32  % 真值序号
  Timestamp: double, Unit="s"  % 真值时间戳
  Valid: boolean  % 真值完整有效

KinematicTruthBus = Simulink.Bus()  % MIL plant 运动学真值
  Position_NED: single[3], Unit="m"  % NED 位置
  Velocity_NED: single[3], Unit="m/s"  % NED 速度
  Sequence: uint32  % 真值序号
  Timestamp: double, Unit="s"  % 真值时间戳
  Valid: boolean  % 真值完整有效

ThrustTorqueBus = Simulink.Bus()  % 动力系统输出的合力与合力矩（机体坐标系）
  Thrust_Body: single[3], Unit="N"  % 机体推力 [Fx, Fy, Fz]
  Torque_Body: single[3], Unit="N*m"  % 机体力矩 [Mx, My, Mz]