% Simulink data dictionary StateEstContractDict.sldd

BarometerBus = Simulink.Bus()  % 气压计测量帧（静压/温度 + 有效性与采样时间戳）
  Pressure: single, Unit="Pa"  % 静压（气压计原始物理量）
  Temperature: single, Unit="degC"  % 传感器温度（用于压力补偿）
  Sequence: uint32  % 测量帧序号
  Timestamp: double, Unit="s"  % 测量采样时间戳
  IsNew: boolean  % 本帧为新样本（仅一拍为真）
  Valid: boolean  % 测量帧有效标志（帧完整性，非质量等级）

GPSBus = Simulink.Bus()  % GPS/RTK 测量帧（含有效性、质量与采样时间戳）
  Lat: single, Unit="deg"  % 纬度
  Lon: single, Unit="deg"  % 经度
  Alt: single, Unit="m"  % 海拔（WGS84 椭球高）
  Velocity: single[3], Unit="m/s"  % NED 速度
  FixType: uint8  % 定位类型（MAVLink GPS_FIX_TYPE）
  NumSat: uint8  % 参与解算卫星数
  Eph: single, Unit="m"  % 水平定位不确定度(1σ)，由 DOP 预算派生
  Epv: single, Unit="m"  % 垂直定位不确定度(1σ)，由 DOP 预算派生
  Sequence: uint32  % 测量帧序号
  Timestamp: double, Unit="s"  % 测量采样时间戳
  IsNew: boolean  % GPS 消息为新帧
  Valid: boolean  % 测量帧有效标志（帧完整性，非质量等级）

GPSSnapshotBus = Simulink.Bus()  % GPS 测量观察快照
  Lat: single, Unit="deg"  % 纬度
  Lon: single, Unit="deg"  % 经度
  Alt: single, Unit="m"  % 海拔（WGS84 椭球高）
  Velocity: single[3], Unit="m/s"  % NED 速度
  FixType: uint8  % 定位类型（MAVLink GPS_FIX_TYPE）
  NumSat: uint8  % 参与解算卫星数
  Eph: single, Unit="m"  % 水平定位不确定度(1σ)
  Epv: single, Unit="m"  % 垂直定位不确定度(1σ)
  MeasurementValid: boolean  % 原测量有效
  Sequence: uint32  % 测量序号
  Timestamp: double, Unit="s"  % 测量时间戳
  Valid: boolean  % 快照完整有效

IMUBus = Simulink.Bus()  % IMU 原始测量帧（含有效性与采样时间戳）
  Accel: single[3], Unit="m/s^2"  % 机体坐标系比力
  Gyro: single[3], Unit="rad/s"  % 机体坐标系角速率
  Sequence: uint32  % 测量帧序号
  Timestamp: double, Unit="s"  % 测量采样时间戳
  IsNew: boolean  % IMU 消息为新帧
  Valid: boolean  % 测量帧有效标志

IMUSnapshotBus = Simulink.Bus()  % IMU 测量观察快照
  Accel: single[3], Unit="m/s^2"  % 机体比力
  Gyro: single[3], Unit="rad/s"  % 机体角速度
  MeasurementValid: boolean  % 原测量有效
  Sequence: uint32  % 测量序号
  Timestamp: double, Unit="s"  % 测量时间戳
  Valid: boolean  % 快照完整有效

MagnetometerBus = Simulink.Bus()  % 磁力计测量帧（机体磁场/磁航向 + 有效性与采样时间戳）
  Mag_Body: single[3], Unit="uT"  % 机体坐标系磁场矢量
  Heading_Mag: single, Unit="rad"  % 倾斜补偿磁航向（NED）
  HeadingValid: boolean  % 磁航向可用（倾斜/场强判据通过）
  Declination: single, Unit="rad"  % 该帧参考场磁偏角（真航向 = 磁航向 + 磁偏角）
  Sequence: uint32  % 测量帧序号
  Timestamp: double, Unit="s"  % 测量采样时间戳
  IsNew: boolean  % 本帧为新样本（仅一拍为真）
  Valid: boolean  % 测量帧有效标志（帧完整性，非质量等级）

StateAttitudeSnapshotBus = Simulink.Bus()  % 姿态与角速率状态快照
  Attitude_quat: single[4]  % 姿态四元数 [w x y z]
  AngularRate_Body: single[3], Unit="rad/s"  % 机体角速度
  Sequence: uint32  % 快照序号
  Timestamp: double, Unit="s"  % 快照时间戳
  Valid: boolean  % 快照完整有效

StateEstBus = Simulink.Bus()  % 状态估计主数据（控制反馈路径）
  Position_NED: single[3], Unit="m"  % 位置估计（北东地）
  Velocity_NED: single[3], Unit="m/s"  % 速度估计（北东地）
  Attitude_quat: single[4]  % 姿态四元数 [w x y z]
  AngularRate_Body: single[3], Unit="rad/s"  % 机体角速度估计
  Sequence: uint32  % 主数据序号
  Timestamp: double, Unit="s"  % 估计时间戳
  Valid: boolean  % 主数据完整有效

StateEstDiagnosticBus = Simulink.Bus()  % 状态估计器诊断快照
  Accel_Body: single[3], Unit="m/s^2"  % 机体加速度
  GyroBias: single[3], Unit="rad/s"  % 陀螺零偏
  AccelBias: single[3], Unit="m/s^2"  % 加速度计零偏
  Wind_NED: single[3], Unit="m/s"  % NED 风速
  Sequence: uint32  % 快照序号
  Timestamp: double, Unit="s"  % 快照时间戳
  Valid: boolean  % 快照完整有效

StateEstHealthBus = Simulink.Bus()  % 状态估计器健康权威快照
  PositionEstimateValid: boolean  % 位置估计可用
  HeadingEstimateValid: boolean  % 航向估计可用
  SensorsHealthy: boolean  % 估计所需传感器健康
  EstimatorHealthy: boolean  % 估计器内部状态健康
  Sequence: uint32  % 快照序号
  Timestamp: double, Unit="s"  % 快照时间戳
  Valid: boolean  % 快照完整有效

StateSnapshot = Simulink.Bus()  % SE→Navigator 当前状态快照（段边界锚点，仅位置/速度）
  Position_NED: single[3], Unit="m"  % 当前估计位置（NED）
  Velocity_NED: single[3], Unit="m/s"  % 当前估计速度（NED）
  Sequence: uint32  % 快照序号
  Timestamp: double, Unit="s"  % 快照时间戳
  Valid: boolean  % 快照完整有效