% Simulink data dictionary FlightControlDict.sldd
% references StateEstContractDict.sldd
% references ControlContractDict.sldd
% references VehicleDict.sldd
% references ActuatorConfigDict.sldd

TC_POSITION_CONTROL_TS = Simulink.Parameter(0.02, StorageClass="ExportedGlobal", DataType="double")  % V0位置控制环显式离散周期，50 Hz。
posP_xy = Simulink.Parameter(single(0.4), StorageClass="ExportedGlobal")  % 水平位置 P 增益。位置误差→速度指令。增大加快位置响应，过大引发超调
posFilterN = Simulink.Parameter(single(20), StorageClass="ExportedGlobal")  % 位置PID导数滤波系数；在50 Hz周期下满足N*Ts不超过0.5。
posI_xy = Simulink.Parameter(single(0.02), StorageClass="ExportedGlobal")  % 水平位置 I 增益。消除悬停稳态位置误差和常值风扰
posD_xy = Simulink.Parameter(single(0), StorageClass="ExportedGlobal")  % 水平位置 D 增益。当前=0（微分由角速率环 D 提供）
posP_z = Simulink.Parameter(single(1), StorageClass="ExportedGlobal")  % 高度位置 P 增益。垂直增益 > 水平增益以积极对抗重力偏差
posI_z = Simulink.Parameter(single(0.1), StorageClass="ExportedGlobal")  % 高度位置 I 增益
posD_z = Simulink.Parameter(single(0), StorageClass="ExportedGlobal")  % 高度位置 D 增益。当前=0
maxVel_xy = Simulink.Parameter(single(10), StorageClass="ExportedGlobal")  % 水平速度指令上限
maxVel_z = Simulink.Parameter(single(3), StorageClass="ExportedGlobal")  % 垂直速度指令上限
TC_VELOCITY_CONTROL_TS = Simulink.Parameter(0.02, StorageClass="ExportedGlobal", DataType="double")  % V0速度控制环显式离散周期，50 Hz。
velFilterN = Simulink.Parameter(single(20), StorageClass="ExportedGlobal")  % 速度PID导数滤波系数；在50 Hz周期下满足N*Ts不超过0.5。
velP_xy = Simulink.Parameter(single(1.8), StorageClass="ExportedGlobal")  % 水平速度 P 增益。速度误差→加速度指令
velI_xy = Simulink.Parameter(single(0.02), StorageClass="ExportedGlobal")  % 水平速度 I 增益。消除速度稳态误差
velD_xy = Simulink.Parameter(single(0), StorageClass="ExportedGlobal")  % 水平速度 D 增益。当前=0
velP_z = Simulink.Parameter(single(4), StorageClass="ExportedGlobal")  % 垂直速度 P 增益
velI_z = Simulink.Parameter(single(0.05), StorageClass="ExportedGlobal")  % 垂直速度 I 增益
velD_z = Simulink.Parameter(single(0), StorageClass="ExportedGlobal")  % 垂直速度 D 增益。当前=0
maxAcc_xy = Simulink.Parameter(single(5), StorageClass="ExportedGlobal")  % 水平加速度指令上限。限制最大姿态倾斜角
maxAcc_z = Simulink.Parameter(single(6), StorageClass="ExportedGlobal")  % 垂直加速度指令上限
maxTiltAngle = Simulink.Parameter(single(0.5236), StorageClass="ExportedGlobal")  % 最大允许倾斜角 (= 30° = pi/6 rad)。限制水平加速度对应的最大倾角
TC_ATTITUDE_CONTROL_TS = Simulink.Parameter(0.004, StorageClass="ExportedGlobal", DataType="double")  % V0姿态控制环显式离散周期，250 Hz。
attP = Simulink.Parameter(single(8), StorageClass="ExportedGlobal")  % 姿态 P 增益。姿态误差→角速率指令。只用P，I由角速率环承担，防止两级积分器串联振荡
maxRate = Simulink.Parameter(single(3.1416), StorageClass="ExportedGlobal")  % 最大角速率指令 (= π rad/s ≈ 180°/s)
TC_RATE_CONTROL_TS = Simulink.Parameter(0.001, StorageClass="ExportedGlobal", DataType="double")  % 角速率控制器显式离散采样周期。。
rateFilterN = Simulink.Parameter(single(100), StorageClass="ExportedGlobal")  % 角速率PID导数滤波器系数。
rateP = Simulink.Parameter(single(0.15), StorageClass="ExportedGlobal")  % 角速率 P 增益。对抗角速率扰动（突风、重心偏移）
rateI = Simulink.Parameter(single(0.02), StorageClass="ExportedGlobal")  % 角速率 I 增益。消除角速率稳态误差、补偿常值扰动力矩
rateD = Simulink.Parameter(single(0.005), StorageClass="ExportedGlobal")  % 角速率 D 增益。提供角速率阻尼，抑制姿态修正时的振荡
maxTorque = Simulink.Parameter(single(2), StorageClass="ExportedGlobal")  % 单轴力矩指令上限。在电机饱和前拦截过大指令，确保控制在线性区
mixMatrix = Simulink.Parameter(single([1 -1 -1 -1; 1 1 1 -1; 1 1 -1 1; 1 -1 1 1]), StorageClass="ExportedGlobal")  % X型四旋翼混控矩阵 (4×4)。[F, τx, τy, τz]ᵀ → [m1, m2, m3, m4]ᵀ。列分别对应: 总推力、滚转力矩、俯仰力矩、偏航力矩
motorMin = Simulink.Parameter(single(0.05), StorageClass="ExportedGlobal")  % 电机指令最小值（归一化 0~1）。>0 防止电机停转失去姿态调控能力
motorMax = Simulink.Parameter(single(1), StorageClass="ExportedGlobal")  % 电机指令最大值（归一化 0~1）。硬件保护上限