% Simulink data dictionary GatewayDict.sldd
% references CommandContractDict.sldd
% references MissionContractDict.sldd
% references StateEstContractDict.sldd
% references ControlContractDict.sldd
% references GatewayContractDict.sldd

GatewaySystemId = Simulink.Parameter(uint8(1), StorageClass="ExportedGlobal")  % FlightCore MAVLink SystemId
GatewayComponentId = Simulink.Parameter(uint8(1), StorageClass="ExportedGlobal")  % FlightCore MAVLink ComponentId
AuthorizedGcsSystemId = Simulink.Parameter(uint8(255), StorageClass="ExportedGlobal")  % 唯一授权 GCS SystemId
AuthorizedGcsComponentId = Simulink.Parameter(uint8(190), StorageClass="ExportedGlobal")  % 唯一授权 GCS ComponentId
GcsLinkTimeoutSec = Simulink.Parameter(3, StorageClass="ExportedGlobal", DataType="double")  % Accepted Rx Evidence 超时
HeartbeatPeriodSec = Simulink.Parameter(1, StorageClass="ExportedGlobal", DataType="double")  % HEARTBEAT 周期
AttitudePeriodSec = Simulink.Parameter(0.05, StorageClass="ExportedGlobal", DataType="double")  % ATTITUDE_QUATERNION 周期
LocalPositionPeriodSec = Simulink.Parameter(0.1, StorageClass="ExportedGlobal", DataType="double")  % LOCAL_POSITION_NED 周期
GlobalPositionPeriodSec = Simulink.Parameter(0.2, StorageClass="ExportedGlobal", DataType="double")  % GLOBAL_POSITION_INT 周期
PositionTargetPeriodSec = Simulink.Parameter(0.2, StorageClass="ExportedGlobal", DataType="double")  % POSITION_TARGET_LOCAL_NED 周期
ActuatorOutputPeriodSec = Simulink.Parameter(0.2, StorageClass="ExportedGlobal", DataType="double")  % ACTUATOR_OUTPUT_STATUS 周期
SysStatusPeriodSec = Simulink.Parameter(1, StorageClass="ExportedGlobal", DataType="double")  % SYS_STATUS 周期
VfrHudPeriodSec = Simulink.Parameter(0.2, StorageClass="ExportedGlobal", DataType="double")  % VFR_HUD 周期
GpsRawPeriodSec = Simulink.Parameter(0.2, StorageClass="ExportedGlobal", DataType="double")  % GPS_RAW_INT 周期
MissionMaxItems = Simulink.Parameter(uint16(400), StorageClass="ExportedGlobal")  % Standard mission item capacity
MissionStatusPeriodSec = Simulink.Parameter(0.2, StorageClass="ExportedGlobal", DataType="double")  % Mission status telemetry period
MissionServicePeriodSec = Simulink.Parameter(0.02, StorageClass="ExportedGlobal", DataType="double")  % MM acceptance and progress projection service period

GatewayCommandAckTxRequestBus_Ground = struct(
  Valid=false,
  command=uint16(0),
  result=uint8(0),
  progress=uint8(0),
  result_param2=int32(0),
  target_system=uint8(0),
  target_component=uint8(0))

GatewayHeartbeatTxRequestBus_Ground = struct(
  Valid=false,
  custom_mode=uint32(0),
  type=uint8(0),
  autopilot=uint8(0),
  base_mode=uint8(0),
  system_status=uint8(0))

GatewayMissionTxRequestBus_Ground = struct(
  Kind=uint8(0),
  target_system=uint8(0),
  target_component=uint8(0),
  seq=uint16(0),
  count=uint16(0),
  command=uint16(0),
  frame=uint8(0),
  current=uint8(0),
  autocontinue=uint8(0),
  param1=single(0),
  param2=single(0),
  param3=single(0),
  param4=single(0),
  x=int32(0),
  y=int32(0),
  z=single(0),
  type=uint8(0),
  mission_type=uint8(0))

GatewayAttitudeTxRequestBus_Ground = struct(
  Valid=false,
  time_boot_ms=uint32(0),
  q1=single(0),
  q2=single(0),
  q3=single(0),
  q4=single(0),
  rollspeed=single(0),
  pitchspeed=single(0),
  yawspeed=single(0),
  repr_offset_q=single([0; 0; 0; 0]))

GatewayTimeSyncTxRequestBus_Ground = struct(Valid=false, tc1=fi(0, 1, 64, 0), ts1=fi(0, 1, 64, 0))

GatewayLocalPositionTxRequestBus_Ground = struct(
  Valid=false,
  time_boot_ms=uint32(0),
  x=single(0),
  y=single(0),
  z=single(0),
  vx=single(0),
  vy=single(0),
  vz=single(0))

GatewayGlobalPositionTxRequestBus_Ground = struct(
  Valid=false,
  time_boot_ms=uint32(0),
  lat=int32(0),
  lon=int32(0),
  alt=int32(0),
  relative_alt=int32(0),
  vx=int16(0),
  vy=int16(0),
  vz=int16(0),
  hdg=uint16(0))

GatewayPositionTargetTxRequestBus_Ground = struct(
  Valid=false,
  time_boot_ms=uint32(0),
  x=single(0),
  y=single(0),
  z=single(0),
  vx=single(0),
  vy=single(0),
  vz=single(0),
  afx=single(0),
  afy=single(0),
  afz=single(0),
  yaw=single(0),
  yaw_rate=single(0),
  type_mask=uint16(0),
  coordinate_frame=uint8(0))

GatewayActuatorTxRequestBus_Ground = struct(Valid=false, time_usec=fi(0, 0, 64, 0), active=uint32(0), actuator=single(repmat(0, 32, 1)))

GatewayVfrHudTxRequestBus_Ground = struct(
  Valid=false,
  heading=int16(0),
  throttle=uint16(0),
  alt=single(0),
  airspeed=single(0),
  groundspeed=single(0),
  climb=single(0))

GatewayGpsRawTxRequestBus_Ground = struct(
  Valid=false,
  time_usec=fi(0, 0, 64, 0),
  fix_type=uint8(0),
  lat=int32(0),
  lon=int32(0),
  alt=int32(0),
  eph=uint16(0),
  epv=uint16(0),
  vel=uint16(0),
  cog=uint16(0),
  satellites_visible=uint8(0))

GatewaySysStatusTxRequestBus_Ground = struct(
  Valid=false,
  onboard_control_sensors_present=uint32(0),
  onboard_control_sensors_enabled=uint32(0),
  onboard_control_sensors_health=uint32(0),
  load=uint16(0),
  voltage_battery=uint16(0),
  current_battery=int16(0),
  battery_remaining=int8(0),
  drop_rate_comm=uint16(0),
  errors_comm=uint16(0),
  errors_count1=uint16(0),
  errors_count2=uint16(0),
  errors_count3=uint16(0),
  errors_count4=uint16(0))

GATE_EMPTY_MISSION = struct(
  TransferId=uint32(0),
  Count=uint16(0),
  Command=uint16(repmat(0, 400, 1)),
  Frame=uint8(repmat(0, 400, 1)),
  Params=single(repmat(0, 400, 4)),
  X=int32(repmat(0, 400, 1)),
  Y=int32(repmat(0, 400, 1)),
  Z=single(repmat(0, 400, 1)),
  AutoContinue=uint8(repmat(0, 400, 1)),
  Ready=false)