% Simulink data dictionary MissionManagerDict.sldd
% references CommandContractDict.sldd
% references MissionContractDict.sldd
% references NavigationContractDict.sldd
% references StateEstContractDict.sldd

T_MM = Simulink.Parameter(0.02, StorageClass="ExportedGlobal", DataType="double")  % MissionManager 显式中速离散周期，50 Hz；与位置/速度控制周期对齐
MM_TAKEOFF_CRUISE_SPEED = Simulink.Parameter(single(2), StorageClass="ExportedGlobal")  % 起飞合同巡航速度；复用退役 CMD_MISSION_CRUISE_SPEED 基线值
MM_TAKEOFF_MAX_ACCELERATION = Simulink.Parameter(single(1), StorageClass="ExportedGlobal")  % 起飞合同最大加速度；复用退役 CMD_MISSION_MAX_ACCELERATION 基线值
MM_TAKEOFF_MAX_JERK = Simulink.Parameter(single(2), StorageClass="ExportedGlobal")  % 起飞合同最大 jerk；复用退役 CMD_MISSION_MAX_JERK 基线值
MM_WAYPOINT_MAX_ACCELERATION = Simulink.Parameter(single(1), StorageClass="ExportedGlobal")  % 普通停点航段最大加速度；第一阶段暂定
MM_WAYPOINT_MAX_JERK = Simulink.Parameter(single(2), StorageClass="ExportedGlobal")  % 普通停点航段最大 jerk；第一阶段暂定
MM_LANDING_CRUISE_SPEED = Simulink.Parameter(single(0.5), StorageClass="ExportedGlobal")  % 标称原地降落合同下降速度；第一阶段暂定
MM_LANDING_MAX_ACCELERATION = Simulink.Parameter(single(0.5), StorageClass="ExportedGlobal")  % 标称原地降落合同最大加速度；第一阶段暂定
MM_LANDING_MAX_JERK = Simulink.Parameter(single(1), StorageClass="ExportedGlobal")  % 标称原地降落合同最大 jerk；第一阶段暂定
MM_ARRIVE_HORIZONTAL_TOLERANCE = Simulink.Parameter(single(0.5), StorageClass="ExportedGlobal")  % 停点水平位置误差门限；来自 DES-MM-004 暂定值
MM_ARRIVE_VERTICAL_TOLERANCE = Simulink.Parameter(single(0.3), StorageClass="ExportedGlobal")  % 停点 NED 高度误差门限；来自 DES-MM-004 暂定值
MM_ARRIVE_SPEED_TOLERANCE = Simulink.Parameter(single(0.3), StorageClass="ExportedGlobal")  % 停点三维速度门限；来自 DES-MM-004 暂定值
MM_ARRIVE_YAW_TOLERANCE = Simulink.Parameter(single(0.0349065848), StorageClass="ExportedGlobal")  % 停点偏航误差门限 2 deg；来自 DES-MM-004 暂定值
MM_ARRIVE_CONFIRM_COUNT = Simulink.Parameter(uint16(25), StorageClass="ExportedGlobal")  % 停点连续满足确认周期数；25 x T_MM = 0.5 s，第一阶段暂定
MM_LAND_HEIGHT_TOLERANCE = Simulink.Parameter(single(0.3), StorageClass="ExportedGlobal")  % 标称降落地面高度误差门限；平坦地面 Dground=0，第一阶段暂定
MM_LAND_VERTICAL_SPEED_TOLERANCE = Simulink.Parameter(single(0.2), StorageClass="ExportedGlobal")  % 标称降落垂向速度门限；第一阶段暂定
MM_LAND_HORIZONTAL_SPEED_TOLERANCE = Simulink.Parameter(single(0.2), StorageClass="ExportedGlobal")  % 标称降落水平速度门限；第一阶段暂定
MM_LAND_ANGULAR_RATE_TOLERANCE = Simulink.Parameter(single(0.0872664601), StorageClass="ExportedGlobal")  % 标称降落机体角速度模门限 5 deg/s；第一阶段暂定
MM_LAND_CONFIRM_COUNT = Simulink.Parameter(uint16(25), StorageClass="ExportedGlobal")  % 标称降落连续满足确认周期数；25 x T_MM = 0.5 s，第一阶段暂定
MM_DEFAULT_CRUISE_SPEED = Simulink.Parameter(single(1), StorageClass="ExportedGlobal")  % Basic Mission cruise speed
MM_RTL_HEIGHT = Simulink.Parameter(single(10), StorageClass="ExportedGlobal")  % Simulation RTL altitude above first-fix Home
MM_EMPTY_RESULT = struct(TransferId=uint32(0), PlanId=uint32(0), Result=uint8(0), Accepted=false, Valid=false)

MM_EMPTY_PLAN = struct(
  TaskId=uint32(0),
  SafeTakeoffHeight=single(0),
  CruiseSpeed=single(0),
  WaypointCount=uint16(0),
  WaypointPositionNED=single(repmat(0, 400, 3)),
  TargetYaw=single(repmat(0, 400, 1)),
  RawItemCount=uint16(0),
  WaypointSeq=uint16(repmat(0, 400, 1)),
  HoldSeconds=single(repmat(0, 400, 1)),
  Valid=false)

MM_EMPTY_CONTRACT = struct(
  ContractId=uint32(0),
  PlanId=uint32(0),
  SegmentIndex=uint32(0),
  StartValid=false,
  StartPositionNED=single([0; 0; 0]),
  PassCount=uint8(0),
  PassPositionNED=single(repmat(0, 64, 3)),
  EndPositionNED=single([0; 0; 0]),
  CruiseSpeed=single(0),
  MaxAcceleration=single(0),
  MaxJerk=single(0),
  TargetYaw=single(0),
  Valid=false,
  Sequence=uint32(0),
  Timestamp=0)

MM_EMPTY_STATUS = struct(
  PlanId=uint32(0),
  ExecutionPhase=uint8(0),
  MissionOutcome=uint8(0),
  MissionReason=uint8(0),
  ExecutionHealthy=false,
  MissionFaultCode=uint16(0),
  LandingCompleted=false,
  Sequence=uint32(0),
  Timestamp=0,
  Valid=false)

MM_EMPTY_PLAN_AVAILABLE = struct(Available=false, PlanId=uint32(0), Sequence=uint32(0), Timestamp=0, Valid=false)

MM_EMPTY_PROGRESS = struct(
  PlanId=uint32(0),
  CurrentItemIndex=uint16(0),
  ItemCount=uint16(0),
  ReachedItemIndex=int16(0),
  ActiveContractId=uint32(0),
  Sequence=uint32(0),
  Timestamp=0,
  Valid=false)