% Simulink data dictionary NavigatorDict.sldd
% references NavigationContractDict.sldd
% references StateEstContractDict.sldd
% references ControlContractDict.sldd

NAV_TIME_BISECTION_ITERATIONS = Simulink.Parameter(uint32(24))  % Fixed duration bisection count specified by Navigator detailed design section 3.3.
NAV_ROOT_IMAG_TOL = Simulink.Parameter(1.0e-9, DataType="double")  % Imaginary roundoff tolerance for stationary roots on normalized segment time [0,1].
NAV_SAMPLE_TIME = Simulink.Parameter(0.001, DataType="double")  % Derived from control/flight_control_params.yaml:TC_RATE_CONTROL_TS; regenerate after changes to the FC base period.