% Simulink data dictionary StateEstDict.sldd
% references StateEstContractDict.sldd

g_n = Simulink.Parameter(single([0; 0; 9.81]), StorageClass="ExportedGlobal")  % NED 重力加速度矢量 [g_N, g_E, g_D]。物理常量，不作调参项
imu_sample_time = Simulink.Parameter(0.001, StorageClass="ExportedGlobal", DataType="double")  % IMU 调度/采样周期。用于 SampleTime、Rate Transition 和时间戳语义，默认 0.001s = 1000Hz
ekf_predict_dt = Simulink.Parameter(single(0.001), StorageClass="ExportedGlobal")  % EKF 预测步长数值输入。显式匹配 EKF MATLAB Function 的 single 数值契约
sigma_acc = Simulink.Parameter(single(0.1), StorageClass="ExportedGlobal")  % 加速度计白噪声 PSD。增大→降低加速度计在融合中的权重
sigma_gyr = Simulink.Parameter(single(0.0001), StorageClass="ExportedGlobal")  % 陀螺仪白噪声 PSD。增大→降低陀螺仪在融合中的权重
sigma_ba = Simulink.Parameter(single(1.0e-6), StorageClass="ExportedGlobal")  % 加速度计偏置随机游走 PSD。增大→允许偏置估计更快变化但噪声更大
sigma_bg = Simulink.Parameter(single(1.0e-7), StorageClass="ExportedGlobal")  % 陀螺仪偏置随机游走 PSD。增大→允许偏置估计更快变化但噪声更大
R_pos = Simulink.Parameter(single(1), StorageClass="ExportedGlobal")  % GPS 位置观测噪声方差（EKF 中直接作为 R 对角元使用）。取 GPS_POS_V_NOISE=1.0 m(1σ) 的平方，覆盖垂直最差轴；0.2 会把垂直观测权重放大 5 倍。增大→降低 GPS 位置在修正中的权重
R_vel = Simulink.Parameter(single(0.02), StorageClass="ExportedGlobal")  % GPS 速度观测噪声方差（EKF 中直接作为 R 对角元使用）。GPS_VEL_NOISE=0.1 m/s(1σ) 的平方为 0.01；0.02 兼顾垂直通道实测 0.45 m/s 的偏大噪声。增大→降低 GPS 速度在修正中的权重
SE_EKF_INIT_STATE = Simulink.Parameter(single([0; 0; 0; 0; 0; 0; 1; 0; 0; 0; 0; 0; 0; 0; 0; 0]), StorageClass="ExportedGlobal")  % EKF 16维默认名义状态 [Position_NED; Velocity_NED; Attitude_quat_wxyz; AccelBias; GyroBias]。位置以启动点为局部 NED 原点。
SE_EKF_INIT_COV_DIAG = Simulink.Parameter(single([0.25; 0.25; 0.25; 0.04; 0.04; 0.04; 0.01; 0.01; 0.01; 0.0025; 0.0025; 0.0025; 0.0001; 0.0001; 0.0001]), StorageClass="ExportedGlobal")  % EKF 15维误差状态初始协方差对角线 [Position; Velocity; Attitude; AccelBias; GyroBias]。
P0_pos = Simulink.Parameter(single(1), StorageClass="ExportedGlobal")  % 初始位置协方差。有GPS时可设小值(0.1)，无GPS时设大值(10)
P0_vel = Simulink.Parameter(single(1), StorageClass="ExportedGlobal")  % 初始速度协方差。静止启动时设小值
P0_att = Simulink.Parameter(single(0.1), StorageClass="ExportedGlobal")  % 初始姿态协方差。静止水平放置时可为极小值(1e-4)
P0_ba = Simulink.Parameter(single(0.01), StorageClass="ExportedGlobal")  % 初始加速度计偏置协方差
P0_bg = Simulink.Parameter(single(0.01), StorageClass="ExportedGlobal")  % 初始陀螺仪偏置协方差
ukf_alpha = Simulink.Parameter(single(1), StorageClass="ExportedGlobal")  % UKF Sigma 点散布参数。α=1时Sigma点恰好覆盖±1σ椭球。15维建议α=1
ukf_beta = Simulink.Parameter(single(2), StorageClass="ExportedGlobal")  % UKF 先验分布参数。高斯分布=2。修正协方差权重峰度
ukf_kappa = Simulink.Parameter(single(0), StorageClass="ExportedGlobal")  % UKF 次级缩放参数。κ=0默认；κ=3-n使λ>0保证正定性
SE_EKF_X0 = Simulink.Parameter(single([1; 0; 0; 0; 0; 0; 0; 0; 0; 0; 0; 0; 0; 0; 0; 0; 0; 0; 0; 0; 0; 0; 0; 0; 0; 0; 0; 0]), StorageClass="ExportedGlobal")  % insEKF 28 维初始名义状态。姿态为单位四元数；位置以启动点为局部 NED 原点，由 GPSPreprocess 首帧锁存原点后另行对齐。
SE_EKF_P0_DIAG = Simulink.Parameter(single([0.0001; 0.0001; 0.0001; 0.0001; 0.0001; 0.0001; 0.0001; 1; 1; 1; 0.1; 0.1; 0.1; 0.01; 0.01; 0.01; 100; 100; 100; 0.0001; 0.0001; 0.0001; 1.0e-6; 1.0e-6; 1.0e-6; 0.0001; 0.0001; 0.0001]), StorageClass="ExportedGlobal")  % insEKF 28 维初始协方差对角元，顺序同 SE_EKF_X0。必须逐状态分块：姿态/角速率 rad²、位置 m²、速度 (m/s)²、地磁 uT²、零偏各自量纲。
SE_EKF_Q_DIAG = Simulink.Parameter(single([1.0e-10; 1.0e-10; 1.0e-10; 1.0e-10; 1.0e-8; 1.0e-8; 1.0e-8; 1.0e-10; 1.0e-10; 1.0e-10; 0.0001; 0.0001; 0.0001; 0.0001; 0.0001; 0.0001; 1.0e-8; 1.0e-8; 1.0e-8; 1.0e-8; 1.0e-8; 1.0e-8; 1.0e-10; 1.0e-10; 1.0e-10; 1.0e-8; 1.0e-8; 1.0e-8]), StorageClass="ExportedGlobal")  % insEKF 连续时间加性过程噪声对角元（AdditiveProcessNoise），顺序同 SE_EKF_X0。量纲为各状态量纲平方/Hz。
SE_EKF_R_GYRO = Simulink.Parameter(single(1.0e-6), StorageClass="ExportedGlobal")  % 陀螺仪测量噪声方差（insGyroscope 的 fuse R 对角元）
SE_EKF_R_ACCEL = Simulink.Parameter(single(0.0001), StorageClass="ExportedGlobal")  % 加速度计测量噪声方差（insAccelerometer 的 fuse R 对角元）
SE_EKF_R_MAG = Simulink.Parameter(single(0.01), StorageClass="ExportedGlobal")  % 磁强计测量噪声方差（insMagnetometer 的 fuse R 对角元）
SE_EKF_R_BARO = Simulink.Parameter(single(1), StorageClass="ExportedGlobal")  % 气压计高度测量噪声方差（经 ISA 反算为 NED 下向位置后直接修正 Position_D）
SE_BARO_QNH = Simulink.Parameter(single(101325), StorageClass="ExportedGlobal")  % 估计器侧海平面标准气压参考，用于静压→高度反算。与 SensorDict 的 BARO_QNH 语义一致但分属两侧，不互相读取。
SE_BARO_REF_ALT = Simulink.Parameter(single(0), StorageClass="ExportedGlobal")  % 本地 NED 原点海拔。Position_D = SE_BARO_REF_ALT - h_ISA(P)
SE_ISA_H_SCALE = Simulink.Parameter(single(44330.7695), StorageClass="ExportedGlobal")  % ISA 对流层反算尺度 T0/L = 288.15/0.0065，h = SE_ISA_H_SCALE*(1-(P/QNH)^SE_ISA_EXPONENT)
SE_ISA_EXPONENT = Simulink.Parameter(single(0.190263), StorageClass="ExportedGlobal")  % ISA 对流层反算指数 R*L/g0 = 287.05287*0.0065/9.80665
SE_EKF_DELAY_MAX_US = Simulink.Parameter(single(30000), StorageClass="ExportedGlobal")  % 融合时间地平线延迟（PX4 EKF2_DELAY_MAX）；必须 >= 各传感器标称延迟最大值
SE_EKF_MAX_LATE_US = Simulink.Parameter(single(30000), StorageClass="ExportedGlobal")  % 校正后时刻早于地平线超过此值的测量丢弃（不回放状态）
SE_EKF_IMU_SAMPLE_TIME_US = Simulink.Parameter(single(1000), StorageClass="ExportedGlobal")  % IMU 周期（微秒），供环形缓冲首拍 dt 兜底；与 SE_IMU_SAMPLE_TIME 同一物理量的微秒表示
SE_EKF_IMU_BUF_LEN = Simulink.Parameter(single(48), StorageClass="ExportedGlobal")  % IMU 环形缓冲容量；须满足 (容量-1)*IMU周期 >= DELAY_MAX + 余量
SE_EKF_MEAS_BUF_LEN = Simulink.Parameter(single(8), StorageClass="ExportedGlobal")  % 每路测量环形缓冲容量
SE_EKF_MAX_FUSE_PER_TICK = Simulink.Parameter(single(1), StorageClass="ExportedGlobal")  % 每拍每路最多出队样本数，界定单拍计算量
SE_GPS_DELAY_US = Simulink.Parameter(single(20000), StorageClass="ExportedGlobal")  % GPS 标称测量延迟（镜像 SensorDict 的 GPS_LATENCY_US；PX4 EKF2_GPS_DELAY）
SE_BARO_DELAY_US = Simulink.Parameter(single(5000), StorageClass="ExportedGlobal")  % 气压计标称测量延迟（镜像 SensorDict 的 BARO_LATENCY_US；PX4 EKF2_BARO_DELAY）
SE_MAG_DELAY_US = Simulink.Parameter(single(10000), StorageClass="ExportedGlobal")  % 磁强计标称测量延迟（镜像 SensorDict 的 MAG_LATENCY_US；PX4 EKF2_MAG_DELAY）
SE_EKF_OUTPUT_GAIN = Simulink.Parameter(single(0.002), StorageClass="ExportedGlobal")  % 输出位置残余低通增益（PX4 output_tracking_error 路径）。融合位置前推补偿延迟后与输出位置求差按此增益混回，防长期漂移；标定 dt/TAU（TAU≈0.5s @1kHz ⇒ 0.002）
SE_EKF_MAG_NED = Simulink.Parameter(single([33.9322 -1.4444 38.2691]), StorageClass="ExportedGlobal")  % 本地地磁 NED 参考矢量（uT），15 态 EKF 磁力计融合固定参考场；默认值 = WMM2025 成都（30.66N,104.06E,500m）
SE_EKF_GATE_GPS = Simulink.Parameter(single(25), StorageClass="ExportedGlobal")  % GPS 位置/速度马氏门限平方（6D, chi2(6,0.999)~22.5），超门限本拍 GPS 更新跳过
SE_EKF_GATE_BARO = Simulink.Parameter(single(12), StorageClass="ExportedGlobal")  % 气压高度马氏门限平方（1D, chi2(1,0.999)~10.8），超门限本拍气压更新跳过
SE_EKF_GATE_MAG = Simulink.Parameter(single(300), StorageClass="ExportedGlobal")  % 磁力计马氏门限平方（3D）。冷启动 20deg 航向误差 d2~190 需放行收敛；10x 场强野值 d2~8000 仍被拒。稳态收紧见 verify B4。