% Simulink data dictionary VehicleDict.sldd

mass = Simulink.Parameter(single(1), StorageClass="ExportedGlobal")  % AirSim Generic F450 四旋翼总质量（含电池、载荷）。来源: MultiRotorParams::setupFrameGenericQuad
inertia = Simulink.Parameter(single([0.006721; 0.008041; 0.014279]), StorageClass="ExportedGlobal")  % AirSim Generic F450 转动惯量 [Ixx, Iyy, Izz]，由机身盒体、四个 0.055 kg 电机组件及 0.2275 m 臂长按 MultiRotorParams::computeInertiaMatrix 计算
g = Simulink.Parameter(single(9.80665), StorageClass="ExportedGlobal")  % 重力加速度。物理常量，不应作为调参项暴露
motorArmLength_m = Simulink.Parameter(single(0.2275), StorageClass="ExportedGlobal")  % AirSim Generic F450 电机到重心的水平距离（臂长）
rotor_count = Simulink.Parameter(uint8(4), StorageClass="ExportedGlobal")  % 旋翼数量。当前为 X 型四旋翼
rotor_config = Simulink.Parameter("X", StorageClass="ExportedGlobal", DataType="string")  % 旋翼布局类型: X (X型), Cross (十字型), Hex_X (X型六旋翼), Hex_Plus (+型六旋翼), Octo_X (X型八旋翼)