% Simulink data dictionary VehicleDict.sldd

mass = Simulink.Parameter(single(38), StorageClass="ExportedGlobal")  % 飞行器总质量（含电池、载荷）
inertia = Simulink.Parameter(single([0.02; 0.02; 0.04]), StorageClass="ExportedGlobal")  % 转动惯量 [Ixx, Iyy, Izz]。X型四旋翼 Ixx≈Iyy, Izz≈2×Ixx
g = Simulink.Parameter(single(9.8), StorageClass="ExportedGlobal")  % 重力加速度。物理常量，不应作为调参项暴露
d = Simulink.Parameter(single(0.225), StorageClass="ExportedGlobal")  % 电机到重心的水平距离（臂长）
rotor_count = Simulink.Parameter(uint8(4), StorageClass="ExportedGlobal")  % 旋翼数量。当前为 X 型四旋翼
rotor_config = Simulink.Parameter("X", StorageClass="ExportedGlobal", DataType="string")  % 旋翼布局类型: X (X型), Cross (十字型), Hex_X (X型六旋翼), Hex_Plus (+型六旋翼), Octo_X (X型八旋翼)