% Simulink data dictionary PowerSystemDict.sldd
% references GlobalTypes.sldd
% references VehicleDict.sldd

U_bat = Simulink.Parameter(single(22.2), StorageClass="ExportedGlobal")  % 电池额定输出电压 (= 6S LiPo: 6×3.7V)
w_bias = Simulink.Parameter(single(0), StorageClass="ExportedGlobal")  % 电机转速偏置。补偿油门→转速映射的零点偏移
Cb = Simulink.Parameter(single(1), StorageClass="ExportedGlobal")  % 电池放电系数/容量校正因子。修正电池内阻电压降对推力的影响
Ct = Simulink.Parameter(single(1.1e-5), StorageClass="ExportedGlobal")  % 推力系数。T = Ct × ω²。由桨叶直径、螺距、翼型决定
Cm = Simulink.Parameter(single(1.8e-7), StorageClass="ExportedGlobal")  % 扭矩系数。Q = Cm × ω²。由桨叶气动阻力决定
Jrp = Simulink.Parameter(single(0.00012), StorageClass="ExportedGlobal")  % 转子及螺旋桨总转动惯量。τ = Jrp × dω/dt 决定转速响应速度