% Simulink data dictionary SensorDict.sldd
% references StateEstContractDict.sldd
% references SimulationContractDict.sldd

IMU_ACC_NOISE = Simulink.Parameter(single(0.001), StorageClass="ExportedGlobal")  % 加速度计白噪声密度。Band-Limited White Noise 块的噪声强度
IMU_GYR_NOISE = Simulink.Parameter(single(0.0001), StorageClass="ExportedGlobal")  % 陀螺仪白噪声密度。Band-Limited White Noise 块的噪声强度
IMU_ACC_BIAS = Simulink.Parameter(single([0.05; -0.03; 0.08]), StorageClass="ExportedGlobal")  % 加速度计三轴常值偏置 [x, y, z]
IMU_GYR_BIAS = Simulink.Parameter(single([0.001; -0.002; 0.001]), StorageClass="ExportedGlobal")  % 陀螺仪三轴常值偏置 [x, y, z]
IMU_ACC_BIAS_WALK = Simulink.Parameter(single(0.0001), StorageClass="ExportedGlobal")  % 加速度计偏置随机游走噪声密度
IMU_GYR_BIAS_WALK = Simulink.Parameter(single(1.0e-5), StorageClass="ExportedGlobal")  % 陀螺仪偏置随机游走噪声密度
IMU_ACC_SCALE = Simulink.Parameter(single(0.002), StorageClass="ExportedGlobal")  % 加速度计比例因子误差（无量纲百分比）。输出 = true * (1 + SCALE)
IMU_GYR_SCALE = Simulink.Parameter(single(0.002), StorageClass="ExportedGlobal")  % 陀螺仪比例因子误差（无量纲百分比）。输出 = true * (1 + SCALE)
IMU_SAT_ACC = Simulink.Parameter(single(156.96), StorageClass="ExportedGlobal")  % 加速度计量程上限（±值）。默认 ±16g = ±156.96 m/s²
IMU_SAT_GYR = Simulink.Parameter(single(34.907), StorageClass="ExportedGlobal")  % 陀螺仪量程上限（±值）。默认 ±2000°/s = ±34.907 rad/s
IMU_SAMPLE_RATE = Simulink.Parameter(single(1000), StorageClass="ExportedGlobal")  % IMU 采样率。与模型固定步长一致
GPS_UERE_H = Simulink.Parameter(single(0.6), StorageClass="ExportedGlobal")  % 码/浮点解水平测距误差 UERE(1σ)，HDOP=1 下的等效水平σ。σ_h = HDOP * UERE_H
GPS_UERE_V = Simulink.Parameter(single(1.2), StorageClass="ExportedGlobal")  % 码/浮点解垂直测距误差 UERE(1σ)。σ_v = VDOP * UERE_V
GPS_UERE_VEL = Simulink.Parameter(single(0.1), StorageClass="ExportedGlobal")  % 测速(多普勒)误差(1σ)，三轴共用，与几何弱相关
GPS_RTK_SIGMA_H = Simulink.Parameter(single(0.015), StorageClass="ExportedGlobal")  % RTK 固定解水平基座σ(1σ)，对应 RTK 定位 ±1~2cm
GPS_RTK_SIGMA_V = Simulink.Parameter(single(0.025), StorageClass="ExportedGlobal")  % RTK 固定解垂直基座σ(1σ)，典型 1.5~2x 水平
GPS_BASELINE_PPM = Simulink.Parameter(single(1), StorageClass="ExportedGlobal")  % 基线相关项(ppm)。误差贡献 = PPM*1e-6*基线长(m)，固定解水平项内平方相加
GPS_MULTIPATH_SIGMA = Simulink.Parameter(single(0.01), StorageClass="ExportedGlobal")  % 多路径/环境残差σ(1σ)，固定解下仍存在，标称近地取小值
GPS_DECAY_FACTOR = Simulink.Parameter(single(0.5), StorageClass="ExportedGlobal")  % gpsSensor 失锁后精度衰减率
GPS_GM_TAU = Simulink.Parameter(single(30), StorageClass="ExportedGlobal")  % GNSS 时间相关误差一阶 Gauss-Markov 相关时间。官方 gpsSensor 不含此项
GPS_GM_SIGMA = Simulink.Parameter(single(0.01), StorageClass="ExportedGlobal")  % GNSS 时间相关误差稳态σ(1σ)。叠加在官方白噪声之外
GPS_SEED = Simulink.Parameter(23341, StorageClass="ExportedGlobal", DataType="double")  % gpsSensor/外壳随机流种子，保证确定性复现
GPS_HDOP_NOMINAL = Simulink.Parameter(single(1), StorageClass="ExportedGlobal")  % 无场景驱动时的标称 HDOP（场景 Valid=false 时使用）
GPS_VDOP_NOMINAL = Simulink.Parameter(single(1.5), StorageClass="ExportedGlobal")  % 无场景驱动时的标称 VDOP
GPS_FIXTYPE_NOMINAL = Simulink.Parameter(single(6), StorageClass="ExportedGlobal")  % 无场景驱动时的标称 FixType（6 = RTK_FIXED，MAVLink GPS_FIX_TYPE）
GPS_NUMSAT_NOMINAL = Simulink.Parameter(single(16), StorageClass="ExportedGlobal")  % 无场景驱动时的标称卫星数
GPS_SAMPLE_RATE = Simulink.Parameter(single(5), StorageClass="ExportedGlobal")  % GPS 更新率。通过 Rate Transition 实现降频
GPS_REF_LAT = Simulink.Parameter(single(0), StorageClass="ExportedGlobal")  % Flat Earth to LLA 参考纬度。NED 坐标系原点
GPS_REF_LON = Simulink.Parameter(single(10), StorageClass="ExportedGlobal")  % Flat Earth to LLA 参考经度。NED 坐标系原点
BARO_SAMPLE_RATE = Simulink.Parameter(single(50), StorageClass="ExportedGlobal")  % 气压计更新率（ICP-20100 可配置 ODR），同时作为 altimeterSensor 的 SampleRate
BARO_SEED = Simulink.Parameter(45601, StorageClass="ExportedGlobal", DataType="double")  % altimeterSensor 随机流种子，保证确定性复现
BARO_CONST_BIAS = Simulink.Parameter(single(0.5), StorageClass="ExportedGlobal")  % 标定后残余常值高度偏置。绝对偏置由 QNH/起飞标定承担，此处只建模残余
BARO_NOISE_DENSITY = Simulink.Parameter(single(0.007), StorageClass="ExportedGlobal")  % 高度域噪声密度。ICP-20100 压力噪声 0.4 Pa RMS ≈ 0.033 m RMS；BW≈25 Hz → 0.0067，保守取 0.007。P2 按 datasheet 噪声-OSR 表细化
BARO_BIAS_INSTABILITY = Simulink.Parameter(single(0.1), StorageClass="ExportedGlobal")  % 高度域 bias instability(1/f)。ICP-20100 长期稳定性优；待 datasheet 长期漂移数值回填
BARO_DECAY_FACTOR = Simulink.Parameter(single(0), StorageClass="ExportedGlobal")  % altimeterSensor bias instability 噪声衰减因子（官方默认 0）。官方语义已确认 DecayFactor = bias instability noise decay factor
BARO_RANGE_MIN = Simulink.Parameter(single(30000), StorageClass="ExportedGlobal")  % 量程下限（ICP-20100 标称 30 kPa），用于静压饱和限幅
BARO_RANGE_MAX = Simulink.Parameter(single(110000), StorageClass="ExportedGlobal")  % 量程上限（ICP-20100 标称 110 kPa），用于静压饱和限幅
BARO_RESOLUTION = Simulink.Parameter(single(0.2), StorageClass="ExportedGlobal")  % 输出量化步长（P2 使用，约 1.7 cm）。暂取 0.2 Pa，待 datasheet 输出分辨率回填
BARO_LPF_TAU = Simulink.Parameter(single(0.016), StorageClass="ExportedGlobal")  % 内部低通时间常数（P2 使用），由 ODR/数字滤波带宽推得，约 1/(2*pi*10Hz)
BARO_PNEUMATIC_TAU = Simulink.Parameter(single(0.3), StorageClass="ExportedGlobal")  % 气路一阶滞后时间常数（P3 可选）。0 = 关闭
BARO_STATIC_PORT_KQ = Simulink.Parameter(single(0), StorageClass="ExportedGlobal")  % 静压源位置误差系数（P3 可选），delta_p = KQ * 0.5*rho*V^2。0 = 关闭
BARO_TEMP_OFFSET = Simulink.Parameter(single(0.5), StorageClass="ExportedGlobal")  % 温度通道常值偏置（ICP-20100 集成温度传感器）
BARO_TEMP_NOISE = Simulink.Parameter(single(0.1), StorageClass="ExportedGlobal")  % 温度通道白噪声标准差
BARO_REF_ALT_MSL = Simulink.Parameter(single(0), StorageClass="ExportedGlobal")  % 本地 NED 原点海拔（绝对压换算参考）。只放字典，不作为模型输入端口
BARO_QNH = Simulink.Parameter(single(101325), StorageClass="ExportedGlobal")  % 海平面标准气压参考（QNH），供估计器压力→高度换算
MAG_SAMPLE_RATE = Simulink.Parameter(single(100), StorageClass="ExportedGlobal")  % 磁力计更新率，同时作为 imuSensor 的 SampleRate
MAG_SEED = Simulink.Parameter(77101, StorageClass="ExportedGlobal", DataType="double")  % imuSensor 随机流种子，保证确定性复现
MAG_WMM_EPOCH = Simulink.Parameter(2025, StorageClass="ExportedGlobal", DataType="double")  % WMM 十进制年份（wrldmagm decimalYear）
MAG_CONST_BIAS = Simulink.Parameter(single([1; -0.5; 0.8]), StorageClass="ExportedGlobal")  % 硬磁/常值偏置 [x,y,z]，映射 magparams.ConstantBias【暂定】
MAG_AXES_MISALIGN = Simulink.Parameter(single([100 0 0; 0 100 0; 0 0 100]), StorageClass="ExportedGlobal")  % 轴失准/软磁矩阵（%，100=单位阵），映射 magparams.AxesMisalignment【暂定】
MAG_NOISE_DENSITY = Simulink.Parameter(single([0.2; 0.2; 0.2]), StorageClass="ExportedGlobal")  % 白噪声密度 [x,y,z]，映射 magparams.NoiseDensity【暂定】
MAG_BIAS_INSTABILITY = Simulink.Parameter(single([0.05; 0.05; 0.05]), StorageClass="ExportedGlobal")  % 零偏不稳定性 [x,y,z]，映射 magparams.BiasInstability【暂定】
MAG_RANDOM_WALK = Simulink.Parameter(single([0.02; 0.02; 0.02]), StorageClass="ExportedGlobal")  % 零偏随机游走 [x,y,z]，映射 magparams.RandomWalk【暂定】
MAG_TEMP_BIAS = Simulink.Parameter(single([0; 0; 0]), StorageClass="ExportedGlobal")  % 温度偏置系数，映射 magparams.TemperatureBias【暂定】
MAG_TEMP_SCALE = Simulink.Parameter(single([0; 0; 0]), StorageClass="ExportedGlobal")  % 温度比例系数，映射 magparams.TemperatureScaleFactor【暂定】
MAG_AMBIENT_TEMP = Simulink.Parameter(single(25), StorageClass="ExportedGlobal")  % 环境温度输入（驱动温度误差项）【暂定】
MAG_RANGE = Simulink.Parameter(single(1300), StorageClass="ExportedGlobal")  % 磁力计量程上限（+/-），外壳饱和
MAG_RESOLUTION = Simulink.Parameter(single(0), StorageClass="ExportedGlobal")  % LSB 量化步长（0 = 关闭），映射带通外的外壳量化【暂定】