% Simulink data dictionary StateEstDict.sldd
% references GlobalTypes.sldd
% references VehicleDict.sldd

g_n = Simulink.Parameter(single([0; 0; 9.81]), StorageClass="ExportedGlobal")  % NED 重力加速度矢量 [g_N, g_E, g_D]。物理常量，不作调参项
imu_sample_time = Simulink.Parameter(0.001, StorageClass="ExportedGlobal", DataType="double")  % IMU 调度/采样周期。用于 SampleTime、Rate Transition 和时间戳语义，默认 0.001s = 1000Hz
ekf_predict_dt = Simulink.Parameter(single(0.001), StorageClass="ExportedGlobal")  % EKF 预测步长数值输入。显式匹配 EKF MATLAB Function 的 single 数值契约
sigma_acc = Simulink.Parameter(single(0.001), StorageClass="ExportedGlobal")  % 加速度计白噪声 PSD。增大→降低加速度计在融合中的权重
sigma_gyr = Simulink.Parameter(single(0.0001), StorageClass="ExportedGlobal")  % 陀螺仪白噪声 PSD。增大→降低陀螺仪在融合中的权重
sigma_ba = Simulink.Parameter(single(1.0e-6), StorageClass="ExportedGlobal")  % 加速度计偏置随机游走 PSD。增大→允许偏置估计更快变化但噪声更大
sigma_bg = Simulink.Parameter(single(1.0e-7), StorageClass="ExportedGlobal")  % 陀螺仪偏置随机游走 PSD。增大→允许偏置估计更快变化但噪声更大
R_pos = Simulink.Parameter(single(0.2), StorageClass="ExportedGlobal")  % GPS 位置观测噪声标准差。增大→降低 GPS 位置在修正中的权重
R_vel = Simulink.Parameter(single(0.1), StorageClass="ExportedGlobal")  % GPS 速度观测噪声标准差。增大→降低 GPS 速度在修正中的权重
SE_EKF_INIT_STATE = Simulink.Parameter(single([0; 0; 0; 0; 0; 0; 1; 0; 0; 0; 0; 0; 0; 0; 0; 0]), StorageClass="ExportedGlobal")  % EKF 16维默认名义状态 [Position_NED; Velocity_NED; Attitude_quat_wxyz; AccelBias; GyroBias]。位置以启动点为局部 NED 原点。
SE_EKF_INIT_COV_DIAG = Simulink.Parameter(single([0.25; 0.25; 0.25; 0.04; 0.04; 0.04; 0.01; 0.01; 0.01; 0.0025; 0.0025; 0.0025; 0.0001; 0.0001; 0.0001]), StorageClass="ExportedGlobal")  % EKF 15维误差状态初始协方差对角线 [Position; Velocity; Attitude; AccelBias; GyroBias]。
P0_pos = Simulink.Parameter(single(1), StorageClass="ExportedGlobal")  % 初始位置协方差。有GPS时可设小值(0.1)，无GPS时设大值(10)
P0_vel = Simulink.Parameter(single(1), StorageClass="ExportedGlobal")  % 初始速度协方差。静止启动时设小值
P0_att = Simulink.Parameter(single(0.1), StorageClass="ExportedGlobal")  % 初始姿态协方差。静止水平放置时可为极小值(1e-4)
P0_ba = Simulink.Parameter(single(0.01), StorageClass="ExportedGlobal")  % 初始加速度计偏置协方差
P0_bg = Simulink.Parameter(single(0.01), StorageClass="ExportedGlobal")  % 初始陀螺仪偏置协方差
ukf_alpha = Simulink.Parameter(single(1), StorageClass="ExportedGlobal")  % UKF Sigma 点散布参数。α=1时Sigma点恰好覆盖±1σ椭球。15维建议α=1
ukf_beta = Simulink.Parameter(single(2), StorageClass="ExportedGlobal")  % UKF 先验分布参数。高斯分布=2。修正协方差权重峰度
ukf_kappa = Simulink.Parameter(single(0), StorageClass="ExportedGlobal")  % UKF 次级缩放参数。κ=0默认；κ=3-n使λ>0保证正定性